# Grasshopper definition Double Action Hinge.gh (Grasshopper 1.0.7)
# plug-ins: treesloth01

wedge_length_factor = Slider(1.16, range=1..2)
outer_radius = Slider(16, range=0..100)
inner_radius = Slider(2, range=0..100)
length = Slider(78, range=0..100)
number_of_hinges = Slider(7, range=1..11)
size_of_plate_attached = Slider(66, range=0..100)
thickness_of_plate_attached = Slider(4, range=0..100)
tolerence_between_hinges = Slider(3.501, range=0.1..4)

# ---- group: Hinge size
multiplication = Multiplication(A=outer_radius, B="2.5")

# ----
multiplication_2 = Multiplication(A=wedge_length_factor, B=length)
expression = Expression(x=multiplication_2, y=length, Expression="(x-y)/2")
Z = UnitZ(Factor=expression)
cyl = Cylinder(Base=PlaneXY(0, 0, 0), Radius=outer_radius, Length=length)
neg = Negative(Value=Z)
debrep = DeconstructBrep(Brep=cyl)  # -> Faces, Edges, Vertices
cap = CapHoles(Brep=cyl)
pt = ConstructPoint(XCoordinate=0, YCoordinate=0, ZCoordinate=0)
first_last = FirstLast(List=debrep.Edges)  # -> FirstValue, LastValue
first_last_2 = FirstLast(List=debrep.Vertices)  # -> FirstValue, LastValue
vec2pt = Vector2Pt(PointA=pt, PointB=first_last_2.FirstValue, Unitize=True)  # -> Vector, Length
area = Area(Geometry=first_last.FirstValue)  # -> Area, Centroid
move = Move(Geometry=area.Centroid, Motion=neg)  # -> Geometry, Transform
cyl_2 = Cylinder(Base=move.Geometry, Radius=inner_radius, Length=multiplication_2)
area_2 = Area(Geometry=first_last.LastValue)  # -> Area, Centroid
multiplication_3 = Multiplication(A=vec2pt.Vector, B=size_of_plate_attached)

# ---- group: Fix for infill
X = UnitX(Factor=thickness_of_plate_attached)
expression_2 = Expression(x=X, Expression="(2*-x)/10")
addition = Addition(A=multiplication_3, B=expression_2)

# ----
ln = Line(StartPoint=area.Centroid, EndPoint=area_2.Centroid)
move_2 = Move(Geometry=first_last_2.LastValue, Motion=addition)  # -> Geometry, Transform
Y = UnitY(Factor=thickness_of_plate_attached)
box = Box2Pt(PointA=first_last_2.FirstValue, PointB=move_2.Geometry, Plane=PlaneXY(0, 0, 0))
neg_2 = Negative(Value=Y)
pframes = PerpFrames(Curve=ln, Count=number_of_hinges, Align=True)  # -> Frames, Parameters
extr = Extrude(Base=box, Direction=[Y, neg_2])
panel = Panel("""-1
0""")
cull_i = CullIndex(List=pframes.Frames, Indices=panel, Wrap=True)
cir = Circle(Plane=cull_i, Radius=outer_radius)
move_3 = Move(Geometry=extr, Motion=expression_2)  # -> Geometry, Transform
multiplication_4 = Multiplication(A=vec2pt.Vector, B=multiplication)
Y_2 = UnitY(Factor=outer_radius)
neg_3 = Negative(Value=Y_2)
neg_4 = Negative(Value=multiplication_4)
move_4 = Move(Geometry=cyl_2, Motion=neg_4)  # -> Geometry, Transform

# ---- group: Tolerance gap
xz = XZPlane(Origin=Point(0, 0, 0))
offset = OffsetCurve(Curve=cir, Distance=tolerence_between_hinges, Plane=xz, Corners=1)
panel_2 = Panel("""true
false""")

# ----
splitmul = SplitBrepMultiple(Brep=cap, Cutters=flatten([cir, offset]))

# ---- group: Tolerance gap (continued)
cull = CullPattern(List=splitmul, CullPattern=panel_2)

# ----
cap_2 = CapHoles(Brep=cull)
sdiff = SolidDifference(BrepsA=cap_2, BrepsB=cyl_2)
dispatch = Dispatch(List=sdiff, DispatchPattern=[True, False])  # -> ListA, ListB
brep = Brep(dispatch.ListB)
area_3 = Area(Geometry=dispatch.ListB)  # -> Area, Centroid
sunion = SolidUnion(Breps=flatten([dispatch.ListA, move_3.Geometry]))
rotate = Rotate(Geometry=sunion, Angle=3.141592654, Plane=PlaneXY(0, 0, 0))  # -> Geometry, Transform
move_5 = Move(Geometry=dispatch.ListB, Motion=neg_4)  # -> Geometry, Transform
area_4 = Area(Geometry=move_5.Geometry)  # -> Area, Centroid
move_6 = Move(Geometry=graft(area_3.Centroid), Motion=[neg_3, Y_2])  # -> Geometry, Transform
move_7 = Move(Geometry=graft(area_4.Centroid), Motion=[neg_3, Y_2])  # -> Geometry, Transform
move_8 = Move(Geometry=rotate.Geometry, Motion=neg_4)  # -> Geometry, Transform
debrep_2 = DeconstructBrep(Brep=move_5.Geometry)  # -> Faces, Edges, Vertices
debrep_3 = DeconstructBrep(Brep=dispatch.ListB)  # -> Faces, Edges, Vertices
first_last_3 = FirstLast(List=move_7.Geometry)  # -> FirstValue, LastValue
first_last_4 = FirstLast(List=move_6.Geometry)  # -> FirstValue, LastValue
item = ListItem(List=debrep_3.Faces, Index=Slider(5, range=0..10), Wrap=True)
item_2 = ListItem(List=debrep_2.Faces, Index=Slider(2, range=0..10), Wrap=True)
srf_cp = SurfaceClosestPoint(Point=first_last_3.FirstValue, Surface=item_2)  # -> Point, UVPoint, Distance
srf_cp_2 = SurfaceClosestPoint(Point=first_last_4.LastValue, Surface=item)  # -> Point, UVPoint, Distance
box_2 = Box2Pt(PointA=srf_cp.Point, PointB=srf_cp_2.Point, Plane=PlaneXY(0, 0, 0))
sunion_2 = SolidUnion(Breps=flatten([box_2, dispatch.ListB, move_5.Geometry]))
sdiff_2 = SolidDifference(BrepsA=sunion_2, BrepsB=flatten([move_4.Geometry, cyl_2]))

# ---- group: Output
brep_2 = Brep(move_8.Geometry)
brep_3 = Brep(sunion)
brep_4 = Brep([move_4.Geometry, cyl_2])
brep_5 = Brep(sdiff_2)
