# Grasshopper definition finger.gh (Grasshopper 1.0.7)
# Copyright: 2017

fingers = Slider(5, range=2..10)
width = Slider(10.86, range=0..12)
thickness = Slider(12, range=0..12)
number_slider = Slider(-27, range=-180..180)
length = Slider(159.744, range=0..240)
alt_fingers = BooleanToggle(False)
pt = ConstructPoint(XCoordinate=0, YCoordinate=expr("x/2", width), ZCoordinate=0)
num = Number(length)
division = Division(A=thickness, B=fingers)
box = CenterBox(Base=PlaneXY(0, 0, 0), X=expr("x/2", length), Y=expr("x/2", width), Z=expr("x/2", thickness))
not = GateNot(A=alt_fingers)
dom = ConstructDomain(DomainStart=expr("-x", num), DomainEnd=num)
xz = XZPlane(Origin=pt)
merge = Merge(Data1=alt_fingers, Data2=not)
planesrf = PlaneSurface(Plane=xz, XSize=dom, YSize=Domain(-10, 10))
entwine = Entwine(Branch00=merge, Branch01=reverse(merge), FlattenInputs=True)
Z = UnitZ(Factor=division)
rotate = Rotate(Geometry=box, Angle=degrees(number_slider), Plane=PlaneXY(0, 0, 0))  # -> Geometry, Transform
rotate_2 = Rotate(Geometry=planesrf, Angle=degrees(number_slider), Plane=PlaneXY(0, 0, 0))  # -> Geometry, Transform
eval = Evaluate(F="-(x/2)+(y/2)", x=thickness, y=division)
box_2 = CenterBox(Base=PlaneXY(0, 0, 0), X=expr("x/2", length), Y=expr("x/2", width), Z=expr("x/2", Z))
rotate_3 = Rotate(Geometry=box_2, Angle=degrees(number_slider), Plane=PlaneXY(0, 0, 0))  # -> Geometry, Transform
Z_2 = UnitZ(Factor=eval)
arrlinear = LinearArray(Geometry=[box_2, rotate_3.Geometry], Direction=Z, Count=fingers)  # -> Geometry, Transform
merge_2 = Merge(Data1=planesrf, Data2=rotate_2.Geometry)
merge_3 = Merge(Data1=box, Data2=rotate.Geometry)  # -> reverse(graft(Result))
split = SplitBrep(Brep=merge_3, Cutter=graft(merge_2))
move = Move(Geometry=arrlinear.Geometry, Motion=Z_2)  # -> Geometry, Transform
item = ListItem(List=split, Index=0, Wrap=True)
cap = CapHoles(Brep=item)
cull = CullPattern(List=move.Geometry, CullPattern=entwine)
sdiff = SolidDifference(BrepsA=cap, BrepsB=cull)
