# Grasshopper definition hing.gh (Grasshopper 1.0.7)
# plug-ins: treesloth01

inner_radius = Slider(2, range=0..100)
wedge_length_factor = Slider(1.16, range=1..2)
outer_radius = Slider(18, range=0..100)
length = Slider(78, range=0..100)
size_of_plate_attached = Slider(66, range=0..100)
thickness_of_plate_attached = Slider(4, range=0..100)
tolerence_between_hinges = Slider(4, range=0.1..4)
number_of_hinges = Slider(4, range=0..10)
multiplication = Multiplication(A=wedge_length_factor, B=length)
expression = Expression(x=multiplication, y=length, Expression="(x-y)/2")
Z = UnitZ(Factor=expression)
cyl = Cylinder(Base=PlaneXY(0, 0, 0), Radius=outer_radius, Length=length)
neg = Negative(Value=Z)
debrep = DeconstructBrep(Brep=cyl)  # -> Faces, Edges, Vertices
cap = CapHoles(Brep=cyl)
pt = ConstructPoint(XCoordinate=0, YCoordinate=0, ZCoordinate=0)
first_last = FirstLast(List=debrep.Edges)  # -> FirstValue, LastValue
first_last_2 = FirstLast(List=debrep.Vertices)  # -> FirstValue, LastValue
vec2pt = Vector2Pt(PointA=pt, PointB=first_last_2.FirstValue, Unitize=True)  # -> Vector, Length
area = Area(Geometry=first_last.FirstValue)  # -> Area, Centroid
move = Move(Geometry=area.Centroid, Motion=neg)  # -> Geometry, Transform
cyl_2 = Cylinder(Base=move.Geometry, Radius=inner_radius, Length=multiplication)
area_2 = Area(Geometry=first_last.LastValue)  # -> Area, Centroid
multiplication_2 = Multiplication(A=vec2pt.Vector, B=size_of_plate_attached)

# ---- group: Fix for infill
X = UnitX(Factor=thickness_of_plate_attached)
expression_2 = Expression(x=X, Expression="(2*-x)/10")
addition = Addition(A=multiplication_2, B=expression_2)

# ----
ln = Line(StartPoint=area.Centroid, EndPoint=area_2.Centroid)
move_2 = Move(Geometry=first_last_2.LastValue, Motion=addition)  # -> Geometry, Transform
Y = UnitY(Factor=thickness_of_plate_attached)
box = Box2Pt(PointA=first_last_2.FirstValue, PointB=move_2.Geometry, Plane=PlaneXY(0, 0, 0))
neg_2 = Negative(Value=Y)
pframes = PerpFrames(Curve=ln, Count=number_of_hinges, Align=True)  # -> Frames, Parameters
extr = Extrude(Base=box, Direction=[Y, neg_2])
panel = Panel("""-1
0""")
cull_i = CullIndex(List=pframes.Frames, Indices=panel, Wrap=True)
cir = Circle(Plane=cull_i, Radius=outer_radius)
move_3 = Move(Geometry=extr, Motion=expression_2)  # -> Geometry, Transform
rotate = Rotate(Geometry=move_3.Geometry, Angle=1.570796327, Plane=PlaneXY(0, 0, 0))  # -> Geometry, Transform

# ---- group: Tolerance gap
xz = XZPlane(Origin=Point(0, 0, 0))
offset = OffsetCurve(Curve=cir, Distance=tolerence_between_hinges, Plane=xz, Corners=1)
panel_2 = Panel("""true
false""")

# ----
splitmul = SplitBrepMultiple(Brep=cap, Cutters=flatten([cir, offset]))

# ---- group: Tolerance gap (continued)
cull = CullPattern(List=splitmul, CullPattern=panel_2)

# ----
cap_2 = CapHoles(Brep=cull)
sdiff = SolidDifference(BrepsA=cap_2, BrepsB=cyl_2)
dispatch = Dispatch(List=sdiff, DispatchPattern=[True, False])  # -> ListA, ListB
sunion = SolidUnion(Breps=flatten([dispatch.ListA, move_3.Geometry]))
sunion_2 = SolidUnion(Breps=flatten([dispatch.ListB, rotate.Geometry]))
