# Grasshopper definition Kabuto arikake.gh (Grasshopper 1.0.7)
# plug-ins: treesloth01

brep = Brep(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)
brep_2 = Brep(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)
debrep = DeconstructBrep(Brep=brep_2)  # -> Faces, Edges, Vertices
debrep_2 = DeconstructBrep(Brep=brep)  # -> Faces, Edges, Vertices
item = ListItem(List=debrep.Edges, Index=Slider(0, range=0..12), Wrap=True)
item_2 = ListItem(List=debrep_2.Vertices, Index=0, Wrap=True)  # -> Item, Item1, Item2, Item3, Item4, Item5, Item6, Item7, Item8
len = Length(Curve=item)
item_3 = ListItem(List=debrep_2.Edges, Index=Slider(9, range=0..12), Wrap=True)  # -> Item, Item1, Item2, Item3, Item4
Z = UnitZ(Factor=Slider(6, range=0..100))
Y = UnitY(Factor=len)
len_2 = Length(Curve=item_3.Item4)
Y_2 = UnitY(Factor=expr("x/2", len))
divide = DivideCurve(Curve=item_3.Item, Count="3", Kinks=False)  # -> Points, Tangents, Parameters
addition = Addition(A=Z, B=Y)
panel = Panel("""false
true
true
false""")
Z_2 = UnitZ(Factor=len_2)
neg = Negative(Value=addition)
neg_2 = Negative(Value=Z)
cull = CullPattern(List=divide.Points, CullPattern=panel)
addition_2 = Addition(A=Z_2, B=Y)
multiplication = Multiplication(A=neg_2, B="2")
move = Move(Geometry=cull, Motion=expr("-x", Y))  # -> Geometry, Transform
neg_3 = Negative(Value=addition_2)
addition_3 = Addition(A=multiplication, B=Y_2)
move_2 = Move(Geometry=move.Geometry, Motion=addition_3)  # -> Geometry, Transform
move_3 = Move(Geometry=item_2.Item7, Motion=neg)  # -> Geometry, Transform
move_4 = Move(Geometry=item_2.Item7, Motion=neg_3)  # -> Geometry, Transform
first_last = FirstLast(List=move.Geometry)  # -> FirstValue, LastValue
first_last_2 = FirstLast(List=move_2.Geometry)  # -> FirstValue, LastValue
box = Box2Pt(PointA=item_2.Item5, PointB=move_3.Geometry, Plane=PlaneXY(0, 0, 0))
box_2 = Box2Pt(PointA=item_2.Item5, PointB=move_4.Geometry, Plane=PlaneXY(0, 0, 0))
box_3 = Box2Pt(PointA=first_last.FirstValue, PointB=first_last_2.LastValue, Plane=PlaneXY(0, 0, 0))
sdiff = SolidDifference(BrepsA=brep, BrepsB=box_2)
sunion = SolidUnion(Breps=flatten([box_3, box, sdiff]))
sdiff_2 = SolidDifference(BrepsA=brep_2, BrepsB=sunion)
