# Grasshopper definition Kawai Tsugite.gh (Grasshopper 1.0.7)
# plug-ins: Kangaroo Components

number_slider = Slider(100, range=0..100)
box = CenterBox(Base=PlaneXY(0, 0, 0), X=number_slider, Y=number_slider, Z=number_slider)
debrep = DeconstructBrep(Brep=box)  # -> Faces, Edges, Vertices
area = Area(Geometry=debrep.Faces)  # -> Area, Centroid
vec = VectorXYZ(XComponent="1", YComponent="1", ZComponent="1")  # -> Vector, Length
box_corners = BoxCorners(Box=box)  # -> CornerA, CornerB, CornerC, CornerD, CornerE, CornerF, CornerG, CornerH
pdecon = Deconstruct(Point=area.Centroid)  # -> XComponent, YComponent, ZComponent
sort = SortList(Keys=pdecon.ZComponent, ValuesA=debrep.Faces)  # -> Keys, ValuesA
pl = PlaneNormal(Origin=box_corners.CornerC, ZAxis=vec.Vector)
pl_2 = PlaneNormal(Origin=box_corners.CornerB, ZAxis=vec.Vector)
item = ListItem(List=sort.ValuesA, Index=0, Wrap=True)
merge = Merge(Data1=pl_2, Data2=pl)
sec = BrepPlane(Brep=box, Plane=merge)  # -> simplify(Curves), Points
bang = ExplodeTree(Data=sec.Curves)  # -> Branch0, Branch1
crv = Curve(bang.Branch1)
crv_2 = Curve(bang.Branch0)
explode = Explode(Curve=crv_2, Recursive=True)  # -> Segments, Vertices
area_2 = Area(Geometry=crv_2)  # -> Area, Centroid
num = Number(number_slider)
area_3 = Area(Geometry=sec.Curves)  # -> Area, Centroid
vec_2 = Vector(vec.Vector)
divide = DivideCurve(Curve=explode.Segments, Count="3", Kinks=False)  # -> Points, Tangents, Parameters
scale = Scale(Geometry=sec.Curves, Center=area_3.Centroid, Factor="5")  # -> Geometry, Transform
multiplication = Multiplication(A=num, B="5")
dom = ConstructDomain(DomainStart=0, DomainEnd=1)
dom_2 = ConstructDomain(DomainStart=2, DomainEnd=3)
amp = Amplitude(Vector=vec_2, Amplitude=multiplication)
boundary = BoundarySurfaces(Edges=scale.Geometry)
subset = SubList(List=divide.Points, Domain=dom_2, Wrap=True)  # -> List, Index
subset_2 = SubList(List=divide.Points, Domain=dom, Wrap=True)  # -> List, Index
extr = Extrude(Base=boundary, Direction=amp)
pline = PolyLine(Vertices=subset_2.List, Closed=False)
pline_2 = PolyLine(Vertices=subset.List, Closed=False)
sdiff = SolidDifference(BrepsA=box, BrepsB=extr)
merge_2 = Merge(Data1=pline, Data2=pline_2)  # -> flatten(Result)
bang_2 = ExplodeTree(Data=sdiff)  # -> Branch0, Branch1
join = JoinCurves(Curves=merge_2, Preserve=False)
geo = Geometry(bang_2.Branch1)
extr_2 = ExtrudePoint(Base=join, Point=area_2.Centroid)
scale_2 = Scale(Geometry=extr_2, Center=area_2.Centroid, Factor="5")  # -> Geometry, Transform
extr_3 = Extrude(Base=scale_2.Geometry, Direction=amp)  # -> graft(Extrusion)
timer = Timer(Interval=20, TimerInterval=20, Target=counter)  # disabled
counter = Counter(Reset=Toggle(False))
Z = UnitZ(Factor=Slider(419, range=0..1000))
neg = Negative(Value=Z)
geo_2 = Geometry(item)
multiplication_2 = Multiplication(A=counter, B=Slider(0, range=0..10))
sint = SolidIntersection(BrepsA=geo, BrepsB=simplify(extr_3))
geo_3 = Geometry(bang_2.Branch0)
extr_4 = Extrude(Base=geo_2, Direction=neg)
neg_2 = Negative(Value="1")
rad = Radians(Degrees=multiplication_2)
merge_3 = Merge(Data1=geo_3, Data2=sint, Data3=extr_4)  # -> flatten(Result)
sin = Sine(Value=rad)
dom_3 = ConstructDomain(DomainStart=neg_2, DomainEnd="1")
list = ValueList({"Animation": 0, "Slider": 1}, selected="Slider")
remap = RemapNumbers(Value=sin, Source=dom_3, Target=Domain(0, 1))  # -> Mapped, Clipped
filter = StreamFilter(Gate=list, Stream0=remap.Mapped, Stream1=Slider(1, range=0..1))
sunion = SolidUnion(Breps=merge_3)
geo_4 = Geometry(sunion)
dom_4 = ConstructDomain(DomainStart=Slider(0.5, range=0..1), DomainEnd=Slider(1, range=0..1))
dom_5 = ConstructDomain(DomainStart=Slider(1, range=0..1), DomainEnd=Slider(1.5, range=0..1.5))
multiplication_3 = Multiplication(A=filter, B=2)
remap_2 = RemapNumbers(Value=filter, Source=Domain(0, 1), Target=dom_4)  # -> Mapped, Clipped
preview = CustomPreview(Geometry=sunion, Material=ColourSwatch(SwatchColor=RGB(217, 154, 72)))
remap_3 = RemapNumbers(Value=filter, Source=Domain(0, 1), Target=dom_5)  # -> Mapped, Clipped
pi = Pi(Factor=multiplication_3)
neg_3 = Negative(Value="1")
pi_2 = Pi(Factor=remap_3.Mapped)
pi_3 = Pi(Factor=remap_2.Mapped)
cos = Cosine(Value=pi)
dom_6 = ConstructDomain(DomainStart="1", DomainEnd=neg_3)
xy = XYPlane(Origin=Point(0, 0, 0))
xz = XZPlane(Origin=Point(0, 0, 0))
remap_4 = RemapNumbers(Value=cos, Source=dom_6, Target=Slider(500, range=0..1000))  # -> Mapped, Clipped
rotate = Rotate(Geometry=geo_4, Angle=pi_3, Plane=xz)  # -> Geometry, Transform
vec_3 = Vector(vec_2)
rotate_2 = Rotate(Geometry=xy, Angle=pi_3, Plane=xz)  # -> Geometry, Transform
amp_2 = Amplitude(Vector=vec_3, Amplitude=remap_4.Mapped)
rotate_3 = Rotate(Geometry=rotate.Geometry, Angle=pi_2, Plane=rotate_2.Geometry)  # -> Geometry, Transform
move = Move(Geometry=rotate_3.Geometry, Motion=amp_2)  # -> Geometry, Transform
preview_2 = CustomPreview(Geometry=move.Geometry, Material=ColourSwatch(SwatchColor=RGB(235, 170, 84)))
