# Grasshopper definition Waffle.gh (Grasshopper 1.0.7)

# ---- group: Controles
u_count = Slider(5, range=0..100)
v_count = Slider(10, range=0..100)
thickness = Slider(3, range=0..10)

# ----
brep = Brep(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)
box = Box(brep)
deconstruct_brep = DeconstructBrep(Brep=box)  # -> Faces, Edges, Vertices
list_item = ListItem(List=deconstruct_brep.Vertices, Index=0, Wrap=True)
list_item_2 = ListItem(List=deconstruct_brep.Edges, Index=0, Wrap=True)
list_item_3 = ListItem(List=deconstruct_brep.Edges, Index=Slider(8, range=0..10), Wrap=True)
number = Number(list_item_3)
number_2 = Number(list_item_2)
unit_z = UnitZ(Factor=Slider(0.01, range=0..0.01))
unit_x = UnitX(Factor=1)
division = Division(A=number, B=v_count)
division_2 = Division(A=number_2, B=u_count)
move = Move(Geometry=list_item, Motion=unit_z)  # -> Geometry, Transform
unit_z_2 = UnitZ(Factor=1)
contour = Contour(Shape=brep, Point=list_item, Direction=unit_x, Distance=expr("x-0.01", division_2))  # -> flatten(Contours)
number_slider = Slider(0, range=0..100)
contour_2 = Contour(Shape=brep, Point=move.Geometry, Direction=unit_z_2, Distance=expr("x-0.01", division))  # -> flatten(Contours)
number_slider_2 = Slider(0, range=0..100)
cull_index = CullIndex(List=contour, Indices=number_slider, Wrap=True)  # -> reverse(List)
cull_index_2 = CullIndex(List=contour_2, Indices=number_slider_2, Wrap=True)  # -> reverse(List)
cull_index_3 = CullIndex(List=cull_index, Indices=number_slider, Wrap=True)
unit_x_2 = UnitX(Factor=expr("-x/2", thickness))
cull_index_4 = CullIndex(List=cull_index_2, Indices=number_slider_2, Wrap=True)
unit_z_3 = UnitZ(Factor=expr("-x/2", thickness))
move_2 = Move(Geometry=cull_index_3, Motion=unit_x_2)  # -> Geometry, Transform
move_3 = Move(Geometry=cull_index_4, Motion=unit_z_3)  # -> Geometry, Transform
unit_x_3 = UnitX(Factor=thickness)
unit_z_4 = UnitZ(Factor=thickness)
surface = Surface(move_2.Geometry)
surface_2 = Surface(move_3.Geometry)
extrude = Extrude(Base=surface_2, Direction=unit_z_4)
extrude_2 = Extrude(Base=surface, Direction=unit_x_3)
cross_reference = CrossReference(ListListA=extrude_2, ListListB=extrude, CrossMode=1)  # -> ListListA, ListListB
brep_brep = BrepBrep(BrepA=cross_reference.ListListA, BrepB=cross_reference.ListListB)  # -> Curves, Points
bounding_box = BoundingBox(Content=brep_brep.Curves, Plane=PlaneXY(0, 0, 0), UnionBox=True)  # -> Box, Box_2
deconstruct_brep_2 = DeconstructBrep(Brep=bounding_box.Box)  # -> Faces, Edges, Vertices
list_item_4 = ListItem(List=deconstruct_brep_2.Edges, Index=Slider(5, range=0..10), Wrap=True)
number_3 = Number(list_item_4)
division_3 = Division(A=number_3, B=Slider(2, range=0..10))
unit_y = UnitY(Factor=division_3)
move_4 = Move(Geometry=bounding_box.Box, Motion=unit_y)  # -> Geometry, Transform
move_5 = Move(Geometry=bounding_box.Box, Motion=expr("-x", unit_y))  # -> Geometry, Transform
solid_difference = SolidDifference(BrepsA=flatten(extrude), BrepsB=flatten(move_5.Geometry))
solid_difference_2 = SolidDifference(BrepsA=flatten(extrude_2), BrepsB=flatten(move_4.Geometry))
