# Grasshopper definition agokaki.gh (Grasshopper 1.0.7)
# plug-ins: Pufferfish

position = Slider(0.681, range=0.1..0.9)
brep = Brep(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)
brep_2 = Brep(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)
grove = Slider(4, range=0..10)
depth = Slider(45, range=0..100)
debrep = DeconstructBrep(Brep=brep)  # -> Faces, Edges, Vertices
debrep_2 = DeconstructBrep(Brep=brep_2)  # -> Faces, Edges, Vertices
panel = Panel("""7
9""")
item = ListItem(List=debrep_2.Edges, Index=Slider(3, range=0..12), Wrap=True)

# ---- group: Extract Width, Depth, Length
len = Length(Curve=debrep.Edges)
sort = SortList(Keys=len)  # -> Keys, ValuesA
cset = CreateSet(List=sort.Keys)  # -> Set, Map
extract = ListItem(List=cset.Set, Index=0, Wrap=True)  # -> Item, Item1, Item2

len_2 = Length(Curve=debrep_2.Edges)
sort_2 = SortList(Keys=len_2)  # -> Keys, ValuesA
cset_2 = CreateSet(List=sort_2.Keys)  # -> Set, Map
extract_2 = ListItem(List=cset_2.Set, Index=0, Wrap=True)  # -> Item, Item1, Item2

# ----
item_2 = ListItem(List=debrep.Edges, Index=panel, Wrap=True)
division = Division(A=extract.Item, B=grove)
midpt = CurveMiddle(Curve=item)
X = UnitX(Factor=expr("-x", depth))
midpt_2 = CurveMiddle(Curve=item_2)
Y = UnitY(Factor=division)
Z = UnitZ(Factor=extract.Item)
addition = Addition(A=Y, B=X, C=Z)
move = Move(Geometry=midpt, Motion=Y)  # -> Geometry, Transform
split = SplitList(List=midpt_2, Index=1)  # -> ListA, ListB
move_2 = Move(Geometry=midpt, Motion=expr("-x", addition))  # -> Geometry, Transform
ln = Line(StartPoint=split.ListA, EndPoint=split.ListB)
eval = EvaluateLength(Curve=ln, Length=position, Normalized=True)  # -> Point, Tangent, Parameter
move_3 = Move(Geometry=midpt, Motion=expr("-x", X))  # -> Geometry, Transform
box = Box2Pt(PointA=move.Geometry, PointB=move_2.Geometry, Plane=PlaneXY(0, 0, 0))
sdiff = SolidDifference(BrepsA=brep_2, BrepsB=box)
move2pt = MoveToPoint(Geometry=sdiff, PointA=move_3.Geometry, PointB=eval.Point)  # -> Moved, Vector, Transform
sdiff_2 = SolidDifference(BrepsA=brep, BrepsB=move2pt.Moved)
