# Grasshopper definition agokaki_sc.gh (Grasshopper 1.0.7)
# plug-ins: Pufferfish, RhinoCodePluginGH

position = Slider(0.681, range=0.1..0.9)
brep = Brep(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)
brep_2 = Brep(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)
grove = Slider(4, range=0..10)
depth = Slider(45, range=0..100)
debrep = DeconstructBrep(Brep=brep)  # -> Faces, Edges, Vertices
debrep_2 = DeconstructBrep(Brep=brep_2)  # -> Faces, Edges, Vertices
brep_3 = Brep(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)
brep_4 = Brep(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)
panel = Panel("""7
9""")
item = ListItem(List=debrep_2.Edges, Index=Slider(3, range=0..12), Wrap=True)

# ---- group: Extract Width, Depth, Length
len = Length(Curve=debrep.Edges)
sort = SortList(Keys=len)  # -> Keys, ValuesA
cset = CreateSet(List=sort.Keys)  # -> Set, Map
extract = ListItem(List=cset.Set, Index=0, Wrap=True)  # -> Item, Item1, Item2

len_2 = Length(Curve=debrep_2.Edges)
sort_2 = SortList(Keys=len_2)  # -> Keys, ValuesA
cset_2 = CreateSet(List=sort_2.Keys)  # -> Set, Map
extract_2 = ListItem(List=cset_2.Set, Index=0, Wrap=True)  # -> Item, Item1, Item2

# ----
item_2 = ListItem(List=debrep.Edges, Index=panel, Wrap=True)
division = Division(A=extract.Item, B=grove)
midpt = CurveMiddle(Curve=item)
ipy2 = IronPython2Script(x=brep_3, y=brep_4)  # -> out, a, b, c, d, Pcs1, Pcs2
# ---------- ipy2: IronPython ----------
import ghpythonlib.components as gh

edge_1 = gh.DeconstructBrep(y)[1][1]
edge_2 = gh.DeconstructBrep(y)[1][5]
midpoint_1 = gh.CurveMiddle(edge_1)
midpoint_2 = gh.CurveMiddle(edge_2)

# Calculate scaling factor based on x width and desired height
x_width = gh.Length(gh.DeconstructBrep(x)[1][4])
init_height = gh.Length(edge_1)
scaleFactor = x_width /init_height 

scaled_geo_1 = gh.Scale(y, midpoint_1, scaleFactor)
scaled_geo_2 = gh.Scale(y, midpoint_2, scaleFactor)

f = gh.SolidDifference(y, scaled_geo_1[0])
Pcs2 = gh.SolidDifference(f, scaled_geo_2[0])
Pcs1 = gh.SolidDifference(x, Pcs2)
# ---------- end ipy2 ----------
brep_5 = Brep(ipy2.Pcs2)
brep_6 = Brep(ipy2.Pcs1)
X = UnitX(Factor=expr("-x", depth))
midpt_2 = CurveMiddle(Curve=item_2)
Y = UnitY(Factor=division)
Z = UnitZ(Factor=extract.Item)
panel_2 = Panel(ipy2.d)
panel_3 = Panel(ipy2.Pcs1)
panel_4 = Panel(ipy2.Pcs2)
panel_5 = Panel(ipy2.c)
addition = Addition(A=Y, B=X, C=Z)
move = Move(Geometry=midpt, Motion=Y)  # -> Geometry, Transform
panel_6 = Panel(ipy2.a)
panel_7 = Panel(ipy2.b)
line = Line(ipy2.d)
split = SplitList(List=midpt_2, Index=1)  # -> ListA, ListB
move_2 = Move(Geometry=midpt, Motion=expr("-x", addition))  # -> Geometry, Transform
ln = Line(StartPoint=split.ListA, EndPoint=split.ListB)
eval = EvaluateLength(Curve=ln, Length=position, Normalized=True)  # -> Point, Tangent, Parameter
line_2 = Line(ipy2.a)
move_3 = Move(Geometry=midpt, Motion=expr("-x", X))  # -> Geometry, Transform
box = Box2Pt(PointA=move.Geometry, PointB=move_2.Geometry, Plane=PlaneXY(0, 0, 0))
sdiff = SolidDifference(BrepsA=brep_2, BrepsB=box)
move2pt = MoveToPoint(Geometry=sdiff, PointA=move_3.Geometry, PointB=eval.Point)  # -> Moved, Vector, Transform
sdiff_2 = SolidDifference(BrepsA=brep, BrepsB=move2pt.Moved)
