# Grasshopper definition arikake.gh (Grasshopper 1.0.7)
# plug-ins: Pufferfish

position = Slider(0.58, range=0.1..0.9)
brep = Brep(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)
brep_2 = Brep(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)
grove = Slider(4, range=0..10)
depth = Slider(45, range=0..100)
debrep = DeconstructBrep(Brep=brep)  # -> Faces, Edges, Vertices
debrep_2 = DeconstructBrep(Brep=brep_2)  # -> Faces, Edges, Vertices
panel = Panel("""2
9""")
item = ListItem(List=debrep_2.Edges, Index=Slider(11, range=0..12), Wrap=True)

# ---- group: Extract Width, Depth, Length
len = Length(Curve=debrep.Edges)
sort = SortList(Keys=len)  # -> Keys, ValuesA
cset = CreateSet(List=sort.Keys)  # -> Set, Map
extract = ListItem(List=cset.Set, Index=0, Wrap=True)  # -> Item, Item1, Item2

len_2 = Length(Curve=debrep_2.Edges)
sort_2 = SortList(Keys=len_2)  # -> Keys, ValuesA
cset_2 = CreateSet(List=sort_2.Keys)  # -> Set, Map
extract_2 = ListItem(List=cset_2.Set, Index=0, Wrap=True)  # -> Item, Item1, Item2

# ----
item_2 = ListItem(List=debrep.Edges, Index=Slider(11, range=0..12), Wrap=True)
Y = UnitY(Factor=expr("-x", extract.Item))
midpt = CurveMiddle(Curve=item_2)
move = Move(Geometry=item, Motion=Y)  # -> Geometry, Transform
split = SplitList(List=midpt, Index=1)  # -> ListA, ListB
midpt_2 = CurveMiddle(Curve=move.Geometry)
eval = EvaluateLength(Curve=item_2, Length=position, Normalized=True)  # -> Point, Tangent, Parameter
ln = Line(StartPoint=split.ListA, EndPoint=split.ListB)
scale = Scale(Geometry=move.Geometry, Center=midpt_2, Factor=Slider(0.589, range=0.2..0.8))  # -> Geometry, Transform
end = EndPoints(Curve=move.Geometry)  # -> Start, End
end_2 = EndPoints(Curve=item)  # -> Start, End
end_3 = EndPoints(Curve=scale.Geometry)  # -> Start, End
rec_2pt = Rectangle2Pt(Plane=PlaneXY(0, 0, 0), PointA=end_2.Start, PointB=end.End, Radius=0)  # -> Rectangle, Length
ln_2 = Line(StartPoint=[end_2.Start, end_2.End], EndPoint=[end_3.Start, end_3.End])
ln_3 = Line(StartPoint=end_3.Start, EndPoint=end_3.End)
boxrec = BoxRectangle(Rectangle=rec_2pt.Rectangle, Height=extract_2.Item1)
midpt_3 = CurveMiddle(Curve=item)
join = JoinCurves(Curves=[ln_2, ln_3, item], Preserve=False)
Z = UnitZ(Factor=extract_2.Item)
extr = Extrude(Base=join, Direction=expr("-x", Z))
cap = CapHoles(Brep=extr)
move2pt = MoveToPoint(Geometry=cap, PointA=midpt_3, PointB=eval.Point)  # -> Moved, Vector, Transform
sdiff = SolidDifference(BrepsA=brep_2, BrepsB=boxrec)
sunion = SolidUnion(Breps=[cap, sdiff])
sdiff_2 = SolidDifference(BrepsA=brep, BrepsB=move2pt.Moved)
