# Grasshopper definition bench slave.gh (Grasshopper 1.0.7)

number_slider = Slider(40, range=0..100)
number_slider_2 = Slider(10, range=0..10)
box = DomainBox(Base=PlaneXY(0, 0, 0), X=number_slider_2, Y=number_slider_2, Z=number_slider)
multiplication = Multiplication(A=number_slider, B=Slider(0.5, range=0..0.9))
debrep = DeconstructBrep(Brep=box)  # -> Faces, Edges, Vertices
item = ListItem(List=debrep.Vertices, Index="6", Wrap=True)
item_2 = ListItem(List=debrep.Vertices, Index="5", Wrap=True)
number_slider_3 = Slider(10, range=0..10)
Z = UnitZ(Factor=1)
neg = Negative(Value=Z)
X = UnitX(Factor=Slider(2, range=0..100))
Z_2 = UnitZ(Factor=Slider(4, range=0..100))
line = LineSDL(Start=item, Direction=neg, Length=multiplication)
line_2 = LineSDL(Start=item_2, Direction=neg, Length=multiplication)
neg_2 = Negative(Value=Z_2)
neg_3 = Negative(Value=X)
line_3 = Line()
addition = Addition(A=neg_3, B=neg_2)
divide = DivideCurve(Curve=line_2, Count=number_slider_3, Kinks=False)  # -> Points, Tangents, Parameters
divide_2 = DivideCurve(Curve=line, Count=number_slider_3, Kinks=False)  # -> flatten(Points), Tangents, Parameters
vec = Vector(addition)
Y = UnitY(Factor=1)
move = Move(Geometry=divide.Points, Motion=addition)  # -> Geometry, Transform
neg_4 = Negative(Value=vec)
circle = CircleCNR(Center=move.Geometry, Normal=Y, Radius=1)
