# Grasshopper definition box joint.gh (Grasshopper 1.0.7)

size = Slider(25, range=0..100)
number_slider = Slider(4, range=0..10)
xy = XYPlane(Origin=Point(0, 0, 0))
rectangle = Rectangle(Plane=xy, XSize=size, YSize=size, Radius=0)  # -> Rectangle, Length
explode = Explode(Curve=rectangle.Rectangle, Recursive=True)  # -> Segments, Vertices
item = ListItem(List=explode.Segments, Index="3", Wrap=True)
divide = DivideCurve(Curve=item, Count=Slider(9, range=0..100), Kinks=False)  # -> Points, Tangents, Parameters
shatter = Shatter(Curve=item, Parameters=divide.Parameters)
X = UnitX(Factor=number_slider)
move = Move(Geometry=shatter, Motion=X)  # -> Geometry, Transform
expression = Expression(x=X, Expression="-x * 2")
extr = Extrude(Base=move.Geometry, Direction=expression)
X_2 = UnitX(Factor=size)
dispatch = Dispatch(List=extr, DispatchPattern=[True, False])  # -> ListA, ListB
move_2 = Move(Geometry=dispatch.ListB, Motion=X_2)  # -> Geometry, Transform
merge = Merge(Data1=dispatch.ListA, Data2=move_2.Geometry)
rdiff = RegionDifference(CurvesA=rectangle.Rectangle, CurvesB=merge)
Z = UnitZ(Factor=number_slider)
boundary = BoundarySurfaces(Edges=rdiff)
extr_2 = Extrude(Base=boundary, Direction=Z)
