# Grasshopper definition chigaihagi.gh (Grasshopper 1.0.7)
# plug-ins: treesloth01

brep = Brep(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)
debrep = DeconstructBrep(Brep=brep)  # -> Faces, Edges, Vertices
depth = Slider(100, range=0..100)

# ---- group: Extract Width, Depth, Length
len = Length(Curve=debrep.Edges)
sort = SortList(Keys=len)  # -> Keys, ValuesA
cset = CreateSet(List=sort.Keys)  # -> Set, Map
extract = ListItem(List=cset.Set, Index=0, Wrap=True)  # -> Item, Item1, Item2

# ----
item = ListItem(List=debrep.Edges, Index=Slider(10, range=0..12), Wrap=True)
item_2 = ListItem(List=debrep.Edges, Index=Slider(6, range=0..12), Wrap=True)
end = EndPoints(Curve=item_2)  # -> Start, End
end_2 = EndPoints(Curve=item)  # -> Start, End
Y = UnitY(Factor=depth)
neg = Negative(Value=Y)
division = Division(A=extract.Item, B="2")
Z = UnitZ(Factor=division)
addition = Addition(A=Z, B=neg)
move = Move(Geometry=[end.Start, end.End], Motion=expr("-x", addition))  # -> Geometry, Transform
move_2 = Move(Geometry=[end_2.Start, end_2.End], Motion=addition)  # -> Geometry, Transform
first_last = FirstLast(List=move_2.Geometry)  # -> FirstValue, LastValue
first_last_2 = FirstLast(List=move.Geometry)  # -> FirstValue, LastValue
box = Box2Pt(PointA=end.End, PointB=first_last_2.FirstValue, Plane=PlaneXY(0, 0, 0))
box_2 = Box2Pt(PointA=end_2.End, PointB=first_last.FirstValue, Plane=PlaneXY(0, 0, 0))
sdiff = SolidDifference(BrepsA=brep, BrepsB=[box, box_2])
