# Grasshopper definition dovetail.gh (Grasshopper 1.0.7)

size = Slider(10, range=0..10)
offset = Slider(0.05, range=0..1)
thickness = Slider(2, range=0..10)
depth = Slider(2, range=0..2)
xy = XYPlane(Origin=Point(0, 0, 0))
rectangle = Rectangle(Plane=xy, XSize=size, YSize=size, Radius=0)  # -> Rectangle, Length
explode = Explode(Curve=rectangle.Rectangle, Recursive=True)  # -> Segments, Vertices
item = ListItem(List=explode.Segments, Index="3", Wrap=True)
divide = DivideCurve(Curve=item, Count=Slider(5, range=0..100), Kinks=False)  # -> Points, Tangents, Parameters
shatter = Shatter(Curve=item, Parameters=divide.Parameters)
X = UnitX(Factor=depth)
move = Move(Geometry=shatter, Motion=X)  # -> Geometry, Transform
midpt = CurveMiddle(Curve=shatter)
midpt_2 = CurveMiddle(Curve=move.Geometry)
expression = Expression(x=X, Expression="-x * 2")
scale = Scale(Geometry=shatter, Center=midpt, Factor=Slider(0.3, range=0..1))  # -> Geometry, Transform
scale_2 = Scale(Geometry=move.Geometry, Center=midpt_2, Factor=Slider(0.7, range=0..1))  # -> Geometry, Transform
end = EndPoints(Curve=scale.Geometry)  # -> Start, End
end_2 = EndPoints(Curve=scale_2.Geometry)  # -> Start, End
panel = Panel("""0
1
2
3""")
weave = Weave(Pattern=panel, Stream0=end.Start, Stream1=end_2.Start, Stream2=end_2.End, Stream3=end.End, NullGaps=False)
pline = PolyLine(Vertices=weave, Closed=True)
X_2 = UnitX(Factor=size)
offset_2 = OffsetCurve(Curve=pline, Distance=offset, Corners=1)
move_2 = Move(Geometry=pline, Motion=X_2)  # -> Geometry, Transform
rdiff = RegionDifference(CurvesA=rectangle.Rectangle, CurvesB=offset_2)
Z = UnitZ(Factor=thickness)
runion = RegionUnion(Curves=[rdiff, move_2.Geometry])  # -> flatten(Result)
boundary = BoundarySurfaces(Edges=runion)
extr = Extrude(Base=boundary, Direction=Z)
