# Grasshopper definition hakodome.gh (Grasshopper 1.0.7)
# plug-ins: treesloth01

# ---- group: Input
brep = Brep(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)
brep_2 = Brep(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)

# ----
depth = Slider(4, range=0..100)
debrep = DeconstructBrep(Brep=brep)  # -> Faces, Edges, Vertices

# ---- group: Extract Width, Depth, Length
len = Length(Curve=debrep.Edges)
sort = SortList(Keys=len)  # -> Keys, ValuesA
cset = CreateSet(List=sort.Keys)  # -> Set, Map
extract = ListItem(List=cset.Set, Index=0, Wrap=True)  # -> Item, Item1, Item2

# ----
item = ListItem(List=debrep.Edges, Index=Slider(4, range=0..12), Wrap=True)

# ---- group: Brep orientaion
debrep_2 = DeconstructBrep(Brep=brep_2)  # -> Faces, Edges, Vertices
item_2 = ListItem(List=debrep_2.Edges, Index=Slider(6, range=0..12), Wrap=True)
midpt = CurveMiddle(Curve=item_2)
midpt_2 = CurveMiddle(Curve=item)
orient = Orient(Geometry=brep_2, Source=midpt, Target=midpt_2)  # -> Geometry, Transform

# ----
Z = UnitZ(Factor=depth)
Y = UnitY(Factor=depth)
neg = Negative(Value=Z)
addition = Addition(A=Y, B=neg)
move = Move(Geometry=item, Motion=Y)  # -> Geometry, Transform
Z_2 = UnitZ(Factor=extract.Item)
subtraction = Subtraction(A=extract.Item, B=depth)
neg_2 = Negative(Value=Z_2)
Y_2 = UnitY(Factor=subtraction)
addition_2 = Addition(A=neg_2, B=Y_2)

# ---- group: Slicing Plane
expression = Expression(x=extract.Item, y=extract.Item, Expression="(sqrt (x²+y²))")
Y_3 = UnitY(Factor=expression)
extr = Extrude(Base=item, Direction=Y_3)
rotate = Rotate(Geometry=extr, Angle=degrees("-45"), Plane=item)  # -> Geometry, Transform

# ----
scale_factor = Slider(0.8, range=0..1)
midpt_3 = CurveMiddle(Curve=move.Geometry)
scale = Scale(Geometry=move.Geometry, Center=midpt_3, Factor=expr("-x", scale_factor))  # -> Geometry, Transform
split = SplitBrep(Brep=brep, Cutter=rotate.Geometry)
move_2 = Move(Geometry=scale.Geometry, Motion=addition)  # -> Geometry, Transform
move_3 = Move(Geometry=scale.Geometry, Motion=addition_2)  # -> Geometry, Transform
first_last = FirstLast(List=split)  # -> FirstValue, LastValue

# ---- group: Pins
number_slider = Slider(5, range=0..10)
divide = DivideCurve(Curve=move_3.Geometry, Count=number_slider, Kinks=False)  # -> Points, Tangents, Parameters
divide_2 = DivideCurve(Curve=move_2.Geometry, Count=number_slider, Kinks=False)  # -> Points, Tangents, Parameters
item_3 = ListItem(List=divide.Points, Index=0, Wrap=True)  # -> Item, Item1, Item2, Item3, Item4
item_4 = ListItem(List=divide_2.Points, Index=0, Wrap=True)  # -> Item, Item1, Item2, Item3, Item4
box = Box2Pt(PointA=item_4.Item3, PointB=item_3.Item4, Plane=PlaneXY(0, 0, 0))
box_2 = Box2Pt(PointA=item_4.Item1, PointB=item_3.Item2, Plane=PlaneXY(0, 0, 0))

# ---- group: Grove box
end = EndPoints(Curve=move_3.Geometry)  # -> Start, End
end_2 = EndPoints(Curve=scale.Geometry)  # -> Start, End
box_3 = Box2Pt(PointA=end_2.Start, PointB=end.End, Plane=PlaneXY(0, 0, 0))

# ----
cap = CapHoles(Brep=first_last.FirstValue)
sdiff = SolidDifference(BrepsA=cap, BrepsB=box_3)
sunion = SolidUnion(Breps=[box_2, box, sdiff])
sdiff_2 = SolidDifference(BrepsA=orient.Geometry, BrepsB=sunion)
