# Grasshopper definition hibukurahagi.gh (Grasshopper 1.0.7)
# plug-ins: Pufferfish

brep = Brep(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)
debrep = DeconstructBrep(Brep=brep)  # -> Faces, Edges, Vertices
item = ListItem(List=debrep.Edges, Index=0, Wrap=True)
item_2 = ListItem(List=debrep.Faces, Index=Slider(7, range=0..10), Wrap=True)
len = Length(Curve=item)
debrep_2 = DeconstructBrep(Brep=item_2)  # -> Faces, Edges, Vertices
item_3 = ListItem(List=debrep_2.Edges, Index=Slider(1, range=0..10), Wrap=True)
item_4 = ListItem(List=debrep_2.Vertices, Index=0, Wrap=True)  # -> Item, Item1, Item2, Item3
item_5 = ListItem(List=debrep_2.Edges, Index=Slider(2, range=0..10), Wrap=True)
md_slider = MDSlider(SliderMode=0, slider_value=Point(0.5, 0.5, 0.5), x_domain=Domain(0, 1), y_domain=Domain(0, 1), z_domain=Domain(0, 1))
len_2 = Length(Curve=item_5)
evalsrf = EvaluateSurface(Surface=reparameterize(item_2), Point=md_slider)  # -> Point, Normal, UDirection, VDirection, Frame
crv_cp = CurveClosestPoint(Point=evalsrf.Point, Curve=item_3)  # -> Point, Parameter, Distance
vec2pt = Vector2Pt(PointA=evalsrf.Point, PointB=crv_cp.Point, Unitize=Toggle(True))  # -> Vector, Length
align = AlignPlane(Plane=evalsrf.Frame, Direction=vec2pt.Vector)  # -> Plane, Angle
depth = Slider(70, range=0..100)
deplane = DeconstructPlane(Plane=align.Plane)  # -> Origin, XAxis, YAxis, ZAxis
division = Division(A=len_2, B=Slider(2, range=0..10))
multiplication = Multiplication(A=deplane.ZAxis, B=depth)
neg = Negative(Value=deplane.XAxis)
neg_2 = Negative(Value=deplane.YAxis)
neg_3 = Negative(Value=deplane.ZAxis)
multiplication_2 = Multiplication(A=neg, B=division)
addition = Addition(A=multiplication_2, B=multiplication)
move = Move(Geometry=item_3, Motion=addition)  # -> Geometry, Transform
end = EndPoints(Curve=move.Geometry)  # -> Start, End
merge = Merge(Data1=end.Start, Data2=item_4.Item1, Data3=end.End, Data4=item_4.Item3)
merge_2 = Merge(Data1=end.Start, Data2=item_4.Item, Data3=end.End, Data4=item_4.Item2)
merge_3 = Merge(Data1=item_4.Item, Data2=item_4.Item1, Data3=end.Start, Data4=item_4.Item1)
merge_4 = Merge(Data1=item_4.Item2, Data2=item_4.Item3, Data3=end.End, Data4=item_4.Item3)
number_slider = Slider(2, range=0..10)
srfgrid = SurfaceFromPoints(Points=merge_2, UCount=number_slider, Interpolate=False)
srfgrid_2 = SurfaceFromPoints(Points=merge, UCount=number_slider, Interpolate=False)
srfgrid_3 = SurfaceFromPoints(Points=merge_4, UCount=number_slider, Interpolate=False)
srfgrid_4 = SurfaceFromPoints(Points=merge_3, UCount=number_slider, Interpolate=False)
mesh = MeshBrep(
    Brep=brep,
    Settings={GridMaxCount=0, GridMinCount=16, JaggedSeams=False, MaxEdgeLength=0, MinEdgeLength=0.0001, MinTolerance=0, Refine=True, RefineAngle=0, RelativeTolerance=0.65, SimplePlanes=True, Tolerance=0})
merge_5 = Merge(Data1=srfgrid, Data2=srfgrid_2, Data3=item_2, Data4=srfgrid_4, Data5=srfgrid_3)  # -> flatten(Result)
mjoin = MeshJoin(Meshes=flatten([merge_5, mesh]))
multiplication_3 = Multiplication(A=deplane.ZAxis, B=len)
msh2psrf = MeshToPolysurface(Mesh=mjoin, Triangles=True, FaceMerge=False)
move_2 = Move(Geometry=msh2psrf, Motion=multiplication_3)  # -> Geometry, Transform
move_3 = Move(Geometry=mjoin, Motion=multiplication_3)  # -> Geometry, Transform
sdiff = SolidDifference(BrepsA=move_2.Geometry, BrepsB=msh2psrf)
mdif = MeshDifference(MeshesA=move_3.Geometry, MeshesB=mjoin)
