# Grasshopper definition honzanehagi.gh (Grasshopper 1.0.7)
# plug-ins: treesloth01

brep = Brep(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)
debrep = DeconstructBrep(Brep=brep)  # -> Faces, Edges, Vertices
panel = Panel("""1
5""")
depth = Slider(100, range=0..100)
item = ListItem(List=debrep.Edges, Index=Slider(0, range=0..12), Wrap=True)
item_2 = ListItem(List=debrep.Edges, Index=panel, Wrap=True)
len = Length(Curve=item)
divide = DivideCurve(Curve=item_2, Count=Slider(3, range=0..10), Kinks=False)  # -> Points, Tangents, Parameters
Y = UnitY(Factor=depth)
panel_2 = Panel("""false
true
true""")
cull = CullPattern(List=divide.Points, CullPattern=panel_2)  # -> flatten(List)
move = Move(Geometry=cull, Motion=Y)  # -> Geometry, Transform
Y_2 = UnitY(Factor=len)
first_last = FirstLast(List=cull)  # -> FirstValue, LastValue
first_last_2 = FirstLast(List=move.Geometry)  # -> FirstValue, LastValue
box = Box2Pt(PointA=first_last.FirstValue, PointB=first_last_2.LastValue, Plane=PlaneXY(0, 0, 0))
sdiff = SolidDifference(BrepsA=brep, BrepsB=box)
move_2 = Move(Geometry=box, Motion=Y_2)  # -> Geometry, Transform
sunion = SolidUnion(Breps=flatten([sdiff, move_2.Geometry]))
