# Grasshopper definition isukatsugi.gh (Grasshopper 1.0.7)

brep = Brep(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)
number_slider = Slider(300, range=0..500)
debrep = DeconstructBrep(Brep=brep)  # -> Faces, Edges, Vertices
division = Division(A=number_slider, B="2")
X = UnitX(Factor=number_slider)
item = ListItem(List=debrep.Vertices, Index=0, Wrap=True)  # -> Item, Item1, Item2, Item3, Item4, Item5, Item6, Item7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
neg = Negative(Value=X)
item_2 = ListItem(List=debrep.Edges, Index=Slider(6, range=0..12), Wrap=True)

# ---- group: Wedge
number_slider_2 = Slider(52, range=0..500)
item_3 = ListItem(List=debrep.Edges, Index=Slider(5, range=0..12), Wrap=True)
len = Length(Curve=item_3)
Y = UnitY(Factor=number_slider_2)
X_2 = UnitX(Factor=Slider(39, range=0..500))
midpt = CurveMiddle(Curve=item_2)
division_2 = Division(A=len, B="2")
division_3 = Division(A=number_slider_2, B="2")
Z = UnitZ(Factor=division_2)
neg_2 = Negative(Value=X_2)
X_3 = UnitX(Factor=division)
Y_2 = UnitY(Factor=division_3)
neg_3 = Negative(Value=Z)
addition = Addition(A=X_3, B=Y_2)
neg_4 = Negative(Value=addition)
addition_2 = Addition(A=neg_3, B=Y, C=neg_2)
move = Move(Geometry=midpt, Motion=neg_4)  # -> Geometry, Transform
move_2 = Move(Geometry=move.Geometry, Motion=addition_2)  # -> Geometry, Transform
box = Box2Pt(PointA=move.Geometry, PointB=move_2.Geometry, Plane=PlaneXY(0, 0, 0))
area = Area(Geometry=box)  # -> Area, Centroid
rotate = Rotate(Geometry=box, Angle=degrees("45"), Plane=area.Centroid)  # -> Geometry, Transform

# ----
move_3 = Move(Geometry=item.Item2, Motion=neg)  # -> Geometry, Transform
move_4 = Move(Geometry=item.Item4, Motion=neg)  # -> Geometry, Transform
len_2 = Length(Curve=item_2)
merge = Merge(Data1=item.Item2, Data2=move_3.Geometry, Data3=item.Item9)  # -> flatten(Result)
merge_2 = Merge(Data1=item.Item5, Data2=move_4.Geometry, Data3=item.Item12)  # -> flatten(Result)
division_4 = Division(A=len_2, B="2")
pt = Point(item.Item2)
move_5 = Move(Motion=Vector(0, 0, 10))  # -> Geometry, Transform
pline = PolyLine(Vertices=merge_2, Closed=True)
neg_5 = Negative(Value=division_4)
pline_2 = PolyLine(Vertices=merge, Closed=True)
Y_3 = UnitY(Factor=division_4)
Y_4 = UnitY(Factor=neg_5)
extr = Extrude(Base=pline_2, Direction=Y_3)
extr_2 = Extrude(Base=pline, Direction=Y_4)
cap = CapHoles(Brep=[extr, extr_2])
sdiff = SolidDifference(BrepsA=brep, BrepsB=[cap, rotate.Geometry])
