# Grasshopper definition kainokuchitsugi.gh (Grasshopper 1.0.7)

cylinder_hight = Slider(200, range=0..200)

# ---- group: Big grove
small_grove_depth = Slider(0.1, range=0..1)
big_grove_depth = Slider(0.75, range=0..1)

# ----
cylinder_radius = Slider(50, range=0..100)
cylinder_hight_2 = Slider(160, range=0..200)
offset_domain = Slider(0.1, range=0..1)
grove_scale = Slider(0.8, range=0..1)

# ---- group: Small grove
small_grove_depth_2 = Slider(0.1, range=0..1)
big_grove_depth_2 = Slider(0.25, range=0..1)

# ----
cyl = Cylinder(Base=PlaneXY(0, 0, 0), Radius=cylinder_radius, Length=cylinder_hight)
cyl_2 = Cylinder(Base=PlaneXY(0, 0, 0), Radius=cylinder_radius, Length=cylinder_hight_2)
pi = Pi(Factor=1)
cap = CapHoles(Brep=cyl_2)
cap_2 = CapHoles(Brep=cyl)
debrep = DeconstructBrep(Brep=cyl_2)  # -> Faces, Edges, Vertices
division = Division(A=pi, B="2")
subtraction = Subtraction(A=division, B=offset_domain)
item = ListItem(List=debrep.Vertices, Index=Slider(1, range=0..1), Wrap=True)
item_2 = ListItem(List=debrep.Edges, Index=0, Wrap=True)  # -> Item, Item1, Item2
dom = ConstructDomain(DomainStart=offset_domain, DomainEnd=subtraction)
arc = Arc(Plane=item_2.Item2, Radius=cylinder_radius, Angle=dom)  # -> Arc, Length
area = Area(Geometry=item_2.Item2)  # -> Area, Centroid
end = EndPoints(Curve=arc.Arc)  # -> Start, End
midpt = CurveMiddle(Curve=arc.Arc)
ln = Line(StartPoint=item, EndPoint=end.Start)
vec2pt = Vector2Pt(PointA=area.Centroid, PointB=midpt, Unitize=True)  # -> Vector, Length
len = Length(Curve=item_2.Item1)
len_2 = Length(Curve=ln)
multiplication = Multiplication(A=len_2, B=vec2pt.Vector)
multiplication_2 = Multiplication(A=len, B=big_grove_depth_2)
multiplication_3 = Multiplication(A=len, B=big_grove_depth)
multiplication_4 = Multiplication(A=len, B=small_grove_depth)
move = Move(Geometry=area.Centroid, Motion=multiplication)  # -> Geometry, Transform
Z = UnitZ(Factor=multiplication_2)
Z_2 = UnitZ(Factor=multiplication_3)
Z_3 = UnitZ(Factor=multiplication_4)
ln_2 = Line(StartPoint=[end.Start, end.End], EndPoint=move.Geometry)
neg = Negative(Value=Z)
neg_2 = Negative(Value=Z_2)
neg_3 = Negative(Value=Z_3)
boundary = BoundarySurfaces(Edges=[ln_2, arc.Arc])
number_slider = Slider(180, range=0..1000)
subtraction_2 = Subtraction(A=neg, B=neg_3)
subtraction_3 = Subtraction(A=neg_2, B=neg_3)
scale = Scale(Geometry=boundary, Center=midpt, Factor=grove_scale)  # -> Geometry, Transform
extr = Extrude(Base=boundary, Direction=neg_2)
extr_2 = Extrude(Base=scale.Geometry, Direction=neg_3)
rotate = Rotate(Geometry=boundary, Angle=1.570796327, Plane=PlaneXY(0, 0, 0))  # -> Geometry, Transform
move_2 = Move(Geometry=extr_2, Motion=subtraction_3)  # -> Geometry, Transform
panel = Panel("""90
-90""")
extr_3 = Extrude(Base=rotate.Geometry, Direction=neg)
rotate_2 = Rotate(Geometry=move_2.Geometry, Angle=degrees(number_slider), Plane=area.Centroid)  # -> Geometry, Transform
rotate_3 = Rotate(Geometry=extr, Angle=degrees(number_slider), Plane=area.Centroid)  # -> Geometry, Transform
rotate_4 = Rotate(Geometry=extr_2, Angle=degrees(panel), Plane=PlaneXY(0, 0, 0))  # -> Geometry, Transform
rotate_5 = Rotate(Geometry=extr_3, Angle=degrees(number_slider), Plane=area.Centroid)  # -> Geometry, Transform
merge = Merge(Data1=rotate_3.Geometry, Data2=extr_3, Data3=rotate_5.Geometry, Data4=extr)  # -> flatten(Result)
move_3 = Move(Geometry=rotate_4.Geometry, Motion=subtraction_2)  # -> Geometry, Transform
sdiff = SolidDifference(BrepsA=cap, BrepsB=merge)  # -> flatten(Result)
merge_2 = Merge(Data1=sdiff, Data2=rotate_2.Geometry, Data3=move_2.Geometry, Data4=move_3.Geometry)  # -> flatten(Result)

# ---- group: Scale to fix Non-manifold
scale_2 = Scale(Geometry=cap_2, Center=Point(0, 0, 0), Factor=Slider(0.95, range=0..1))  # -> Geometry, Transform

# ----
sunion = SolidUnion(Breps=merge_2)
sdiff_2 = SolidDifference(BrepsA=scale_2.Geometry, BrepsB=sunion)
