# Grasshopper definition kakushi domekata sanmai hozo.gh (Grasshopper 1.0.7)
# plug-ins: Human

brep = Brep(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)
debrep = DeconstructBrep(Brep=brep)  # -> Faces, Edges, Vertices
box = DomainBox(Base=PlaneXY(0, 0, 0), X=Slider(7, range=0..100), Y=Slider(58, range=0..100), Z=Slider(19, range=0..100))
debrep_2 = DeconstructBrep(Brep=box)  # -> Faces, Edges, Vertices
item = ListItem(List=debrep.Faces, Index=Slider(5, range=0..10), Wrap=True)
item_2 = ListItem(List=debrep_2.Edges, Index=0, Wrap=True)
preview = CustomPreview(Geometry=item, Material=ColourSwatch(SwatchColor=RGB(255, 143, 143)))
debrep_3 = DeconstructBrep(Brep=item)  # -> Faces, Edges, Vertices
item_3 = ListItem(List=debrep_3.Edges, Index=Slider(2, range=0..10), Wrap=True)
md_slider = MDSlider(SliderMode=0, slider_value=Point(0.5, 0.5, 0.5), x_domain=Domain(0, 1), y_domain=Domain(0, 1), z_domain=Domain(0, 1))
previewlw = CustomPreviewLineweights(Geometry=item_3, Shader=ColourSwatch(SwatchColor=RGB(255, 255, 255)), Thickness=Slider(0.25, range=0..1), Absolute=True)
evalsrf = EvaluateSurface(Surface=reparameterize(item), Point=md_slider)  # -> Point, Normal, UDirection, VDirection, Frame
crv_cp = CurveClosestPoint(Point=evalsrf.Point, Curve=item_3)  # -> Point, Parameter, Distance
vec2pt = Vector2Pt(PointA=evalsrf.Point, PointB=crv_cp.Point, Unitize=Toggle(True))  # -> Vector, Length
align = AlignPlane(Plane=evalsrf.Frame, Direction=vec2pt.Vector)  # -> Plane, Angle
deplane = DeconstructPlane(Plane=align.Plane)  # -> Origin, XAxis, YAxis, ZAxis
neg = Negative(Value=deplane.ZAxis)
neg_2 = Negative(Value=deplane.YAxis)
vdis = VectorDisplay(Anchor=deplane.Origin, Vector=neg)
vdis_2 = VectorDisplay(Anchor=deplane.Origin, Vector=deplane.XAxis)
vdis_3 = VectorDisplay(Anchor=deplane.Origin, Vector=deplane.YAxis)
pl = ConstructPlane(Origin=deplane.Origin, XAxis=deplane.XAxis, YAxis=neg_2)
orient = Orient(Geometry=box, Source=pl, Target=evalsrf.Frame)  # -> Geometry, Transform
