# Grasshopper definition mortise and tenon.gh (Grasshopper 1.0.7)
# plug-ins: Pufferfish

# ---- group: Input 1
geo = Geometry(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)

# ---- group: Tenon Width Factor
number_slider = Slider(1.5, range=1.5..6)

# ----
position = Slider(0.473, range=0.1..0.9)

# ---- group: Tenor depth factor
number_slider_2 = Slider(0.904, range=0..1)

# ---- group: Tenon Heigth Factor
number_slider_3 = Slider(1.2, range=1.2..6)

# ---- group: Input 2
geo_2 = Geometry(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)

# ----
geo_3 = Geometry(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)
geo_4 = Geometry(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)
image_resource = ImageResource("D:\1hisham\Thesis resources\Tenon&Mortise.png")
debrep = DeconstructBrep(Brep=geo)  # -> Faces, Edges, Vertices
debrep_2 = DeconstructBrep(Brep=geo_4)  # -> Faces, Edges, Vertices
panel = Panel("""6
11""")
item = ListItem(List=debrep.Edges, Index=panel, Wrap=True)
item_2 = ListItem(List=debrep_2.Faces, Index=Slider(3, range=0..10), Wrap=True)
midpt = CurveMiddle(Curve=item)
area = Area(Geometry=item_2)  # -> Area, Centroid
split = SplitList(List=midpt, Index=1)  # -> ListA, ListB
ln = Line(StartPoint=split.ListA, EndPoint=split.ListB)
dom = ConstructDomain(DomainStart="0", DomainEnd="1")

# ---- group: Extract Width, Depth, Length
len = Length(Curve=debrep.Edges)
sort = SortList(Keys=len)  # -> Keys, ValuesA
cset = CreateSet(List=sort.Keys)  # -> Set, Map
extract = ListItem(List=cset.Set, Index=0, Wrap=True)  # -> Item, Item1, Item2

len_2 = Length(Curve=debrep_2.Edges)
sort_2 = SortList(Keys=len_2)  # -> Keys, ValuesA
cset_2 = CreateSet(List=sort_2.Keys)  # -> Set, Map
extract_2 = ListItem(List=cset_2.Set, Index=0, Wrap=True)  # -> Item, Item1, Item2

# ----
eval = EvaluateLength(Curve=ln, Length=position, Normalized=True)  # -> Point, Tangent, Parameter

division = Division(A=extract.Item, B=number_slider)
division_2 = Division(A=extract_2.Item, B=number_slider_3)
rectangle = Rectangle(Plane=item_2, XSize=extract.Item, YSize=extract_2.Item, Radius=0)  # -> Rectangle, Length
dom_2 = ConstructDomain(DomainStart=0, DomainEnd=extract.Item)
area_2 = Area(Geometry=rectangle.Rectangle)  # -> Area, Centroid
rectangle_2 = Rectangle(Plane=item_2, XSize=division, YSize=division_2, Radius=0)  # -> Rectangle, Length
area_3 = Area(Geometry=rectangle_2.Rectangle)  # -> Area, Centroid
remap = RemapNumbers(Value=number_slider_2, Source=dom, Target=dom_2)  # -> Mapped, Clipped
move2pt = MoveToPoint(Geometry=rectangle_2.Rectangle, PointA=area_3.Centroid, PointB=area.Centroid)  # -> Moved, Vector, Transform
move2pt_2 = MoveToPoint(Geometry=rectangle.Rectangle, PointA=area_2.Centroid, PointB=area.Centroid)  # -> Moved, Vector, Transform
boxrec = BoxRectangle(Rectangle=move2pt_2.Moved, Height=remap.Mapped)
boxrec_2 = BoxRectangle(Rectangle=move2pt.Moved, Height=remap.Mapped)
sdiff = SolidDifference(BrepsA=geo_4, BrepsB=boxrec)
sunion = SolidUnion(Breps=[boxrec_2, sdiff])

rectangle_3 = Rectangle(Plane=PlaneXY(0, 0, 0), XSize=division, YSize=division_2, Radius=0)  # -> Rectangle, Length
move2pt_3 = MoveToPoint(Geometry=rectangle_3.Rectangle, PointA=area_3.Centroid, PointB=area.Centroid)  # -> Moved, Vector, Transform
boxrec_3 = BoxRectangle(Rectangle=move2pt_3.Moved, Height=remap.Mapped)

debrep_3 = DeconstructBrep(Brep=boxrec_3)  # -> Faces, Edges, Vertices
item_3 = ListItem(List=debrep_3.Faces, Index="5", Wrap=True)
area_4 = Area(Geometry=item_3)  # -> Area, Centroid
move2pt_4 = MoveToPoint(Geometry=boxrec_3, PointA=area_4.Centroid, PointB=eval.Point)  # -> Moved, Vector, Transform
sdiff_2 = SolidDifference(BrepsA=geo, BrepsB=move2pt_4.Moved)
