# Grasshopper definition release_buckle.gh (Grasshopper 1.0.7)
# plug-ins: treesloth01

# ---- group: Controls
position_of_the_clip = Slider(402, range=0..1000)
circle_radius = Slider(276, range=0..300)
grove_hight_percentage = Slider(1.3, range=0.1..10.1)
grove_width = Slider(75, range=0..100)

# ----
brep = Brep(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)
debrep = DeconstructBrep(Brep=brep)  # -> Faces, Edges, Vertices

# ---- group: Clamp
item = ListItem(List=debrep.Edges, Index=0, Wrap=True)  # -> Item, Item1, Item2, Item3, Item4
len = Length(Curve=item.Item4)
midpt = CurveMiddle(Curve=item.Item)
Z = UnitZ(Factor=1)
division = Division(A=len, B=grove_hight_percentage)
line = LineSDL(Start=midpt, Direction=expr("-x", Z), Length=division)
len_2 = Length(Curve=item.Item3)
xz = XZPlane(Origin=Point(0, 0, 0))
neg = Negative(Value=grove_width)
end = EndPoints(Curve=line)  # -> Start, End
Y = UnitY(Factor=len_2)
offset = OffsetCurve(Curve=line, Distance=[grove_width, neg], Plane=xz, Corners=1)  # -> flatten(Curve)
Y_2 = UnitY(Factor=1)
move = Move(Geometry=offset, Motion=Y)  # -> Geometry, Transform
first_last = FirstLast(List=offset)  # -> FirstValue, LastValue
first_last_2 = FirstLast(List=move.Geometry)  # -> FirstValue, LastValue
circle = CircleCNR(Center=end.End, Normal=Y_2, Radius=circle_radius)
end_2 = EndPoints(Curve=first_last_2.LastValue)  # -> Start, End
end_3 = EndPoints(Curve=first_last.FirstValue)  # -> Start, End
extr = Extrude(Base=circle, Direction=Y)
box = Box2Pt(PointA=end_3.Start, PointB=end_2.End, Plane=PlaneXY(0, 0, 0))
cap = CapHoles(Brep=extr)
sunion = SolidUnion(Breps=[cap, box])
sdiff = SolidDifference(BrepsA=brep, BrepsB=sunion)

# ---- group: buckle
item_2 = ListItem(List=debrep.Faces, Index=0, Wrap=True)
area = Area(Geometry=item_2)  # -> Area, Centroid
scale = Scale(Geometry=item_2, Center=area.Centroid, Factor=Slider(3, range=1..10))  # -> Geometry, Transform
scale_nu = ScaleNU(Geometry=item_2, Plane=area.Centroid, ScaleX=Slider(0.68, range=0..1), ScaleY=1, ScaleZ=1)  # -> Geometry, Transform
Z_2 = UnitZ(Factor=expr("x*100", Slider(2, range=1..10)))
extr_2 = Extrude(Base=scale.Geometry, Direction=Z_2)
extr_3 = Extrude(Base=scale_nu.Geometry, Direction=Z_2)
cap_2 = CapHoles(Brep=extr_3)
cap_3 = CapHoles(Brep=extr_2)
Z_3 = UnitZ(Factor=position_of_the_clip)
sdiff_2 = SolidDifference(BrepsA=cap_3, BrepsB=cap_2)
neg_2 = Negative(Value=Z_3)
move_2 = Move(Geometry=sdiff_2, Motion=neg_2)  # -> Geometry, Transform

# ----
sdiff_3 = SolidDifference(BrepsA=sdiff, BrepsB=move_2.Geometry)
