# Grasshopper definition scarf.gh (Grasshopper 1.0.7)
# Copyright: 2017

loa = Slider(12, range=0..36)
angle_1 = Slider(8, range=0..45)
angle_2 = Slider(37, range=0..45)
l_chop = Slider(3.471, range=0..10)

# ---- group: Consruction Plane
pitch = Slider(90, range=-180..180)
yaw = Slider(0, range=-180..180)
roll = Slider(0, range=-180..180)

# ----
xz = XZPlane(Origin=Point(0, 0, 0))
neg = Negative(Value=loa)
neg_2 = Negative(Value=l_chop)

# ---- group: Consruction Plane
prot = RotatePlane(Plane=xz, Angle=degrees(yaw))
deplane = DeconstructPlane(Plane=prot)  # -> Origin, XAxis, YAxis, ZAxis
line = LineSDL(Start=deplane.Origin, Direction=deplane.YAxis, Length=1)
rotax = RotateAxis(Geometry=prot, Angle=expr("-x", degrees(pitch)), Axis=line)  # -> Geometry, Transform
prot_2 = RotatePlane(Plane=rotax.Geometry, Angle=degrees(roll))

# ---- group: Beams
thickness = Slider(7.5, range=0..12)
length = Slider(110.4, range=0..240)
width = Slider(7.02, range=0..12)
box = CenterBox(Base=prot_2, X=expr("x/2", length), Y=expr("x/2", width), Z=expr("x/2", thickness))

# ----
merge = Merge(Data1=loa, Data2=neg)
merge_2 = Merge(Data1=l_chop, Data2=neg_2)
deplane_2 = DeconstructPlane(Plane=prot_2)  # -> Origin, XAxis, YAxis, ZAxis
amp = Amplitude(Vector=deplane_2.XAxis, Amplitude=merge)
move = Move(Geometry=prot_2, Motion=amp)  # -> Geometry, Transform
merge_3 = Merge(Data1=ColourSwatch(SwatchColor=RGBA(255, 255, 0, 61)), Data2=ColourSwatch(SwatchColor=RGBA(0, 0, 255, 49)))
rotate = Rotate(Geometry=move.Geometry, Angle=degrees(angle_1), Plane=prot_2)  # -> Geometry, Transform
rotate_2 = Rotate(Geometry=rotate.Geometry, Angle=degrees(angle_2), Plane=rotate.Geometry)  # -> Geometry, Transform
deplane_3 = DeconstructPlane(Plane=rotate_2.Geometry)  # -> Origin, XAxis, YAxis, ZAxis
amp_2 = Amplitude(Vector=deplane_3.YAxis, Amplitude=merge_2)
move_2 = Move(Geometry=deplane_3.Origin, Motion=amp_2)  # -> Geometry, Transform
item = ListItem(List=move_2.Geometry, Index=0, Wrap=True)  # -> Item, Item1
entwine = Entwine(Branch00=item.Item, Branch01=deplane_3.Origin, Branch02=item.Item1, FlattenInputs=True)  # -> flatten(Result)
pline = PolyLine(Vertices=entwine, Closed=False)

Z = Slider(12, range=0..24)
neg_3 = Negative(Value=Z)
merge_4 = Merge(Data1=Z, Data2=neg_3)
amp_3 = Amplitude(Vector=deplane_3.ZAxis, Amplitude=merge_4)
move_3 = Move(Geometry=pline, Motion=amp_3)  # -> Geometry, Transform
loft = Loft(Curves=move_3.Geometry, Options={Adjust=False, Closed=False, LoftEnds=0, LoftSimp=0, LoftType=0, Rebuild=10, Refit=0.01})
preview = CustomPreview(Geometry=loft, Shader=ColourSwatch(SwatchColor=RGBA(255, 0, 0, 61)))

split = SplitBrep(Brep=box, Cutter=loft)
preview_2 = CustomPreview(Geometry=split, Shader=merge_3)
item_2 = ListItem(List=split, Index=0, Wrap=True)
thickness_2 = Slider(2.868, range=0..12)
edges = BrepEdges(Brep=item_2)  # -> Naked, Interior, NonManifold
length_2 = Slider(2.084, range=0..6)
width_2 = Slider(2.116152, range=0..12, expression="-x")
Z_2 = UnitZ(Factor=1)
dprod = DotProduct(VectorA=deplane_2.XAxis, VectorB=edges.Naked, Unitize=False)
dom = ConstructDomain(DomainStart=expr("-x/2", thickness_2), DomainEnd=expr("x/2", thickness_2))
align = AlignPlane(Plane=rotate.Geometry, Direction=Z_2)  # -> Plane, Angle
smaller = SmallerThan(FirstNumber=expr("abs(x)", dprod), SecondNumber=0.0001)  # -> SmallerThan, OrEqualTo
box_2 = DomainBox(Base=align.Plane, X=length_2, Y=width_2, Z=dom)
item_3 = ListItem(List=align.Plane, Index=0, Wrap=True)
deplane_4 = DeconstructPlane(Plane=item_3)  # -> Origin, XAxis, YAxis, ZAxis
cull = CullPattern(List=edges.Naked, CullPattern=invert(smaller.SmallerThan))
item_4 = ListItem(List=box_2, Index=0, Wrap=True)  # -> Item, Item1
rot3d = Rotate3D(Geometry=item_4.Item, Angle=3.141592654, Center=deplane_4.Origin, Axis=deplane_4.XAxis)  # -> Geometry, Transform
join = JoinCurves(Curves=cull, Preserve=False)
neg_4 = Negative(Value=thickness_2)
rotate_3 = Rotate(Geometry=item_4.Item, Angle=3.141592654, Plane=item_3)  # -> Geometry, Transform
merge_5 = Merge(Data1=thickness_2, Data2=neg_4)
disc = Discontinuity(Curve=join, Level=1)  # -> Points, Parameters
amp_4 = Amplitude(Vector=deplane_4.ZAxis, Amplitude=merge_5)
bang = ExplodeTree(Data=disc.Points)  # -> _00000, _00001
move_4 = Move(Geometry=rot3d.Geometry, Motion=amp_4)  # -> Geometry, Transform
preview_3 = CustomPreview(
    Geometry=[box_2, move_4.Geometry],
    Shader={diffuse=RGB(255, 105, 180), emission=RGB(76, 32, 54), shine=0.5, specular=RGB(255, 255, 255), transparency=0})
entwine_2 = Entwine(Branch00=bang._00000, Branch01=reverse(bang._00001), FlattenInputs=True)
pline_2 = PolyLine(Vertices=entwine_2, Closed=False)  # -> flatten(Polyline)
loft_2 = Loft(Curves=pline_2, Options={Adjust=False, Closed=False, LoftEnds=0, LoftSimp=0, LoftType=0, Rebuild=10, Refit=0.01})
join_2 = BrepJoin(Breps=flatten([item_2, loft_2]))  # -> Breps, Closed
sdiff = SolidDifference(BrepsA=join_2.Breps, BrepsB=item_4.Item1)
sunion = SolidUnion(Breps=[sdiff, rotate_3.Geometry])
sdiff_2 = SolidDifference(BrepsA=box, BrepsB=sunion)
sdiff_3 = SolidDifference(BrepsA=box, BrepsB=sdiff_2)
preview_4 = CustomPreview(Geometry=sdiff_2, Shader=ColourSwatch(SwatchColor=RGBA(0, 0, 255, 49)))
preview_5 = CustomPreview(Geometry=sdiff_3, Shader=ColourSwatch(SwatchColor=RGBA(255, 255, 0, 61)))
